# Grasshopper definition versionB2.ghx (Grasshopper 0.9.76)

subtraction = Subtraction(A=Slider(3, range=0..10), B=Slider(8, range=0..10))
number = Number(subtraction)
mass_addition = MassAddition(Input=["33", number, Slider(343, range=0..1000)])  # -> Result, PartialResults
panel = Panel(mass_addition.Result)
